# Grasshopper definition WireDisplayToggle.gh (Grasshopper 0.9.76)

# ---- group: Example
data = Data("Happy")
data_2 = Data("Holidays")
join = TextJoin(Text=[data, data_2], Join=" ")
panel = Panel(join)

# ----
wdt = CSharpScript(showFaintWires=Toggle(True))  # inputs showFaintWires: Boolean
# ---------- wdt: C# ----------
    foreach(IGH_ActiveObject ao in GrasshopperDocument.ActiveObjects()){
      if(ao is IGH_Param){
        IGH_Param param = ao as IGH_Param;
        fixWires(param, showFaintWires);
      } else if(ao is IGH_Component){
        IGH_Component comp = ao as IGH_Component;
        foreach(IGH_Param param in comp.Params){
          fixWires(param, showFaintWires);
        }
      }
    }
# ---------- wdt: C# additional code ----------
  void fixWires(IGH_Param param, bool showFaint){
    if(showFaint && param.WireDisplay == GH_ParamWireDisplay.hidden){
      param.WireDisplay = GH_ParamWireDisplay.faint;
    } else if((!showFaint) && param.WireDisplay == GH_ParamWireDisplay.faint){
      param.WireDisplay = GH_ParamWireDisplay.hidden;
    }
  }
# ---------- end wdt ----------
