# Grasshopper definition randomLayerColor.gh (Grasshopper 0.9.76)
# plug-ins: Human

panel = Panel("""Fuchsia
LawnGreen
OrangeRed
Maroon
Lime
Red
Brown
Orange
Gold
Yellow
Chartreuse
Green
DarkGreen
SeaGreen
Aquamarine
Cyan
Turquoise
Lavender
Blue
Purple
Magenta
Violet
Pink""")
layertable = LayerTable(Update=Button(), AutoUpdate=False)  # -> Layers, FullLayerPaths, LayerColors, Linetypes, MaterialNames, Visible, PrintWidth, PrintColor
lng = ListLength(List=layertable.Layers)
lng_2 = ListLength(List=panel)  # -> expr("x-1", Length)
col = Colour(panel)
random = Random(Range=lng_2, Number=lng, Seed=2, Integers=True)
item = ListItem(List=col, Index=random, Wrap=True)
layers = CreateModifyLayers(LayerName=layertable.Layers, LayerColor=item, DeleteLayer=False, enableFullPath=False)  # -> LayerNames, LayerFullPath
