# Grasshopper definition straight-staircase.gh (Grasshopper 0.9.76)
# plug-ins: Human

riser_height = Slider(224, range=0..500)
tread_depth = Slider(351, range=0..500)
X = UnitX(Factor=1)
width_staircase = Slider(442, range=0..1400)
total_height = Slider(20200, range=0..35000)
Y = UnitY(Factor=tread_depth)
division = Division(A=total_height, B=riser_height)

# ---- group: Saved pt?
pt = Point(Point(705932.5625, 885798.8125, -37500.00391))

# ----
series = Series(Start=0, Step=riser_height, Count=division)
pt_2 = Point(Point(0, 0, 0))
arrlinear = LinearArray(Geometry=pt_2, Direction=Y, Count=division)  # -> Geometry, Transform
Z = UnitZ(Factor=series)
move = Move(Geometry=arrlinear.Geometry, Motion=Z)  # -> Geometry, Transform
line = LineSDL(Start=move.Geometry, Direction=X, Length=width_staircase)
shift = ShiftList(List=move.Geometry, Shift=1, Wrap=True)
xy = XYPlane(Origin=shift)
project = Project(Geometry=line, Plane=xy)  # -> Geometry, Transform
path_mapper = PathMapper(line, source="{A;B}(i) ", target="{i}")
path_mapper_2 = PathMapper(project.Geometry, source="{A;B;C}(i) ", target="{i}")
ins = InsertItems(List=path_mapper, Item=path_mapper_2, Indices=1, Wrap=True)
dispatch = Dispatch(List=ins, DispatchPattern=[True, False])  # -> ListA, flatten(ListB)
loft = Loft(Curves=ins, Options={Adjust=False, Closed=False, LoftEnds=0, LoftSimp=0, LoftType=0, Rebuild=10, Refit=0.01})  # -> flatten(Loft)
crv = Curve(dispatch.ListB)
crv_2 = Curve(dispatch.ListA)
shift_2 = ShiftList(List=flatten(crv_2), Shift=1, Wrap=True)
path_mapper_3 = PathMapper(crv, source="{A}(i)", target="{0;0;i}")
merge = Merge(Data1=graft(shift_2), Data2=path_mapper_3)
loft_2 = Loft(Curves=merge, Options={Adjust=False, Closed=False, LoftEnds=0, LoftSimp=0, LoftType=0, Rebuild=10, Refit=0.01})  # -> flatten(Loft)
cull_i = CullIndex(List=loft, Indices=-1, Wrap=True)
cull_i_2 = CullIndex(List=loft_2, Indices=-1, Wrap=True)
join = BrepJoin(Breps=[cull_i, cull_i_2])  # -> Breps, Closed
layertable = LayerTable(Update=True, AutoUpdate=False)  # -> Layers, FullLayerPaths, LayerColors, Linetypes, MaterialNames, Visible, PrintWidth, PrintColor
list = ItemSelector(
    layertable.FullLayerPaths,
    {"Default", "Layer 01", "Layer 02", "Layer 03", "Layer 04", "Layer 05", "Layer 06", "Layer 07", "Layer 08", "Layer 09"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}, selected="bord")
createatts = CreateAttributes(LayerName=list, enableFullPath=False)
bake = BakeGeometry(Bake=Button(), Geometry=join.Breps, Attributes=createatts, DeleteOldBakes=False, PreserveTrees=False)
